# Grasshopper definition 01_01.gh (Grasshopper 1.0.5)

python = GhPythonScript(x=Slider(3, range=0..10))  # -> out, a; inputs x: Int32
# ---------- python: Python ----------
"""This is a simple component.
    Inputs:
        x: The x script variable
        y: The y script variable
    Output:
        a: The a output variable"""

import rhinoscriptsyntax as rs

print x
# ---------- end python ----------
panel = Panel(python.out)
