# Grasshopper definition 01_03.gh (Grasshopper 1.0.5)

python = GhPythonScript()  # -> out, a
# ---------- python: Python ----------
"""This is a simple component.
    Inputs:
        x: The x script variable
        y: The y script variable
    Output:
        a: The a output variable"""

import rhinoscriptsyntax as rs

a = rs.AddPoint(1,2,3)
print a
# ---------- end python ----------
panel = Panel(python.a)
