# Grasshopper definition 01_04.gh (Grasshopper 1.0.5)

python = GhPythonScript()  # -> out, a
# ---------- python: Python ----------
"""This is a simple component.
    Inputs:
        x: The x script variable
        y: The y script variable
    Output:
        a: The a output variable"""

import Rhino.Geometry as rg

a = rg.Point3d(1,2,3)
print a.X
# ---------- end python ----------
