# Grasshopper definition 02_01.gh (Grasshopper 1.0.5)

python = GhPythonScript()  # -> out, a
# ---------- python: Python ----------
"""This is a simple component.
    Inputs:
        x: The x script variable
        y: The y script variable
    Output:
        a: The a output variable"""

import rhinoscriptsyntax as rs

#Variables
var = 0
a = var

#Reassigning
var = 1
print var

#Using Variable
point = rs.AddPoint(var, 0, 0)
a = point

#Naming Errors
#4var = 1
#%var = 3
_var = 1

hello = 1
Hello = 2

print hello
print Hello
import = 1
# ---------- end python ----------
