# Grasshopper definition 02_02.gh (Grasshopper 1.0.5)

python = GhPythonScript()  # -> out, a
# ---------- python: Python ----------
"""This is a simple component.
    Inputs:
        x: The x script variable
        y: The y script variable
    Output:
        a: The a output variable"""

import rhinoscriptsyntax as rs

#Addition
addition = 2 + 3
print addition

#Precision
check = 0.1 + 0.2
print check == 0.3

rounded = round(check, 1)
print rounded == 0.3

#Division
print 5/2

#Multiplication, Subtraction, and Exponents
print 6 * 2
print 6 - 2
print 2 ** 3

#Modulus
print 8 % 2

#PEMDAS
print (2 + 5) * 4
# ---------- end python ----------
