# Grasshopper definition 02_03.gh (Grasshopper 1.0.5)

python = GhPythonScript()  # -> out, a
# ---------- python: Python ----------
"""This is a simple component.
    Inputs:
        x: The x script variable
        y: The y script variable
    Output:
        a: The a output variable"""

import rhinoscriptsyntax as rs

#Strings
word = "Hello"
print word

#Adding Strings
geo = "Point "
coord = "123"
point = geo + coord
print point

#Indexing
print point[0]
print point[-1]

#Slicing
print point[5:]
print point[:5]

#Formatting
loc = "Point is at {}".format(123)
print loc

#Casting
xyz = 545
print "Point is at" + str(xyz)
# ---------- end python ----------
