# Grasshopper definition 02_04.gh (Grasshopper 1.0.5)

python = GhPythonScript()  # -> out, a
# ---------- python: Python ----------
"""This is a simple component.
    Inputs:
        x: The x script variable
        y: The y script variable
    Output:
        a: The a output variable"""

import rhinoscriptsyntax as rs

#Lists
emptylist = []
print emptylist

lst = [0,1,2,3,4,5, "Point"]
print lst

print range(10)

#Indexing
print lst[0]
print lst[-1]

lst[0] = "A"
print lst 

#Slicing
print lst[4:6]

copy = lst[:]
print copy

#Adding Items
lst.append(99)
print lst

#Removing Items
lst.pop()
print lst

lst.pop(0)
print lst 

#Other Methods
lst.insert(3,9)
print lst

lst.sort()
print lst

#Tuples
tup = (2,5,4,2,1)
print tup

tup[0] = 2
# ---------- end python ----------
