# Grasshopper definition 02_05.gh (Grasshopper 1.0.5)

pt = ConstructPoint(XCoordinate=Slider(2, range=0..10), YCoordinate=Slider(3, range=0..10), ZCoordinate=Slider(4, range=0..10))
python = GhPythonScript(point=pt)  # -> out, a; inputs point: Point3d
# ---------- python: Python ----------
"""This is a simple component.
    Inputs:
        x: The x script variable
        y: The y script variable
    Output:
        a: The a output variable"""

import rhinoscriptsyntax as rs

#Booleans
T = True
F = False

print T, F

print bool(0)
print bool(5)

#Comparison Operators
print point.X == 3

print point.X != 4

print point.Y > 3
print point.Y < 3

print point.Z <= 4
print point.Z <= 3
# ---------- end python ----------
