# Grasshopper definition 02_06.gh (Grasshopper 1.0.5)

pt = ConstructPoint(XCoordinate=Slider(0, range=0..10), YCoordinate=Slider(0, range=0..10), ZCoordinate=Slider(5, range=0..10))
pt_2 = ConstructPoint(XCoordinate=Slider(0, range=0..10), YCoordinate=Slider(0, range=0..10), ZCoordinate=Slider(25, range=0..30))
python = GhPythonScript(pt1=pt, pt2=pt_2)  # -> out, a; inputs pt1: Point3d, pt2: Point3d
# ---------- python: Python ----------
"""This is a simple component.
    Inputs:
        x: The x script variable
        y: The y script variable
    Output:
        a: The a output variable"""

import Rhino.Geometry as rg

#IF, ELSE, ELIF
T = False

if T:
    print "This is true."
    
line = rg.Line(pt1, pt2)
print line.Length

if line.Length == 10:
    print "Line length is 10"
elif line.Length == 20:
    print "Line Length is 20"
else:
    print "The Line Length is Not 10"
# ---------- end python ----------
