# Grasshopper definition 02_07.gh (Grasshopper 1.0.5)

box = CenterBox(Base=PlaneXY(0, 0, 0), X=Slider(0.865, range=0..10), Y=1, Z=1)
python = GhPythonScript(box=box)  # -> out, a; inputs box: Box
# ---------- python: Python ----------
"""This is a simple component.
    Inputs:
        x: The x script variable
        y: The y script variable
    Output:
        a: The a output variable"""

import rhinoscriptsyntax as rs

print type(box)

boxArea = box.Area
boxVolume = box.Volume

print boxArea
print boxVolume

#Comparing Booleans
#Logical AND Operator

print boxArea < 50 and boxVolume > 10

#Logical OR Operator

print boxArea > 30 or boxVolume < 2

#Logical NOT Operator
print not boxArea == 30
# ---------- end python ----------
area = Area(Geometry=box)  # -> Area, Centroid
volume = Volume(Geometry=box)  # -> Volume, Centroid
panel = Panel(area.Area)
panel_2 = Panel(volume.Volume)
