# Grasshopper definition 02_07.gh (Grasshopper 1.0.5)

box = CenterBox(Base=PlaneXY(0, 0, 0), X=Slider(1.341, range=0..10), Y=1, Z=1)
area = Area(Geometry=box)  # -> Area, Centroid
volume = Volume(Geometry=box)  # -> Volume, Centroid
panel = Panel(area.Area)
panel_2 = Panel(volume.Volume)
