# Grasshopper definition 02_08.gh (Grasshopper 1.0.5)

range = Range(Domain=Domain(0, 9), Steps=9)
python = GhPythonScript(numbers=range)  # -> out, a; inputs numbers: list of Int32
# ---------- python: Python ----------
"""This is a simple component.
    Inputs:
        x: The x script variable
        y: The y script variable
    Output:
        a: The a output variable"""

import Rhino.Geometry as rg

print numbers

lst = []

#For Loop
for var in numbers:
    lst.append(var)

print lst

points = []

for x in numbers:
    point = rg.Point3d(x,0,0)
    points.append(point)

a = points

spheres = []

for x in numbers:
    if x > 4:
        point = rg.Point3d(x,0,0)
        sphere = rg.Sphere(point, 0.3)
        spheres.append(sphere)

a = spheres
# ---------- end python ----------
