# Grasshopper definition 02_09.gh (Grasshopper 1.0.5)

python = GhPythonScript(height=Slider(23, range=0..100))  # -> out, a; inputs height: Int32
# ---------- python: Python ----------
"""This is a simple component.
    Inputs:
        x: The x script variable
        y: The y script variable
    Output:
        a: The a output variable"""

import Rhino.Geometry as rg

#While Loop
var = 0
lst = []

while var < 5:
    lst.append(var)
    var += 1

print lst

cylinders = []
var = 1

while var < height:
    if var == 15:
        var += 1
        continue
    point = rg.Point3d(var, 0, 0)
    circle = rg.Circle(point, 0.4)
    cylinder = rg.Cylinder(circle, var)
    cylinders.append(cylinder)
    var += 1

a = cylinders
# ---------- end python ----------
