# Grasshopper definition 02_10.gh (Grasshopper 1.0.5)

range = Range(Domain=Domain(0, 9), Steps=9)
python = GhPythonScript(numbers=range)  # -> out, a, b; inputs numbers: list of Int32
# ---------- python: Python ----------
"""This is a simple component.
    Inputs:
        x: The x script variable
        y: The y script variable
    Output:
        a: The a output variable"""

import Rhino.Geometry as rg

points = []

#Nested Loops
for x in numbers:
    for y in numbers:
        point = rg.Point3d(x,y,0)
        points.append(point)

pLine = rg.PolylineCurve(points)

a = points
b = pLine
# ---------- end python ----------
