# Grasshopper definition 02_11.gh (Grasshopper 1.0.5)

random = Random(Range=Domain(0, 100), Number=100, Seed=2)
random_2 = Random(Range=Domain(0, 100), Number=100, Seed=3)
pt = ConstructPoint(XCoordinate=random, YCoordinate=0, ZCoordinate=random_2)
python = GhPythonScript()  # -> out, a; inputs points: list of Point3d
# ---------- python: Python ----------
"""This is a simple component.
    Inputs:
        x: The x script variable
        y: The y script variable
    Output:
        a: The a output variable"""

import rhinoscriptsyntax as rs

#Functions
def func():
    return 3

print func()

def FirstLastPt(pts):
    zs = []
    
    if len(pts) == 0:
        return "Empty List"
    
    for point in pts:
        zs.append(point.Z)
        
    sortedp = sorted(zip(zs, pts))
    return sortedp[0][1], sortedp[-1][1]

a = FirstLastPt(points)
# ---------- end python ----------
