# Grasshopper definition 03_01.gh (Grasshopper 1.0.5)

frequency = Slider(0.19, range=0..1)
python = GhPythonScript(amplitude=Slider(6.03, range=0..10), length=Slider(63, range=0..100), frequency=frequency)  # -> out, a; inputs length: Int32
# ---------- python: Python ----------
"""This is a simple component.
    Inputs:
        x: The x script variable
        y: The y script variable
    Output:
        a: The a output variable"""

import Rhino.Geometry as rg
import sys
from math import sin

#Sine Wave
points = []

for x in range(length):
    z = amplitude * sin(frequency * x)
    point = rg.Point3d(x, 0, z)
    points.append(point)

sineCurve = rg.NurbsCurve.CreateInterpolatedCurve(points, 3)

a = sineCurve
# ---------- end python ----------
