# Grasshopper definition 03_01.gh (Grasshopper 1.0.5)

frequency = Slider(0.3, range=0..1)
python = GhPythonScript(amplitude=Slider(4.5, range=0..10), length=Slider(70, range=0..100), frequency=frequency)  # -> out, a; inputs length: Int32
# ---------- python: Python ----------
"""This is a simple component.
    Inputs:
        x: The x script variable
        y: The y script variable
    Output:
        a: The a output variable"""

import Rhino.Geometry as rg
# ---------- end python ----------
