# Grasshopper definition 03_03.gh (Grasshopper 1.0.5)

python = GhPythonScript()  # -> out, a, b, c
# ---------- python: Python ----------
"""This is a simple component.
    Inputs:
        x: The x script variable
        y: The y script variable
    Output:
        a: The a output variable"""

import Rhino.Geometry as rg
import clr
clr.AddReference("Microsoft.Office.Interop.Excel")
import Microsoft.Office.Interop.Excel as excel

#Excel
ex = excel.ApplicationClass()

#Open Workbook
workbook = ex.Workbooks.Open(r"C:\Users\Jerem\Desktop\Exercises\03_03\Start\03_03.xlsx")

#Read Workbook
ws = workbook.Worksheets[1]

pX = []
pY = []
pZ = []

for i in range(ws.UsedRange.Rows.Count):
    if i == 0:
        continue
    
    x = ws.Range("A{}".format(i + 1)).Value2
    y = ws.Range("B{}".format(i + 1)).Value2
    z = ws.Range("C{}".format(i + 1)).Value2
    
    pX.append(x)
    pY.append(y)
    pZ.append(z)

workbook.Close(False)
ex.Quit()

a = pX
b = pY
c = pZ
# ---------- end python ----------
pt = ConstructPoint(XCoordinate=python.a, YCoordinate=python.b, ZCoordinate=python.c)
