# Grasshopper definition 03_05.gh (Grasshopper 1.0.5)

pt = Point([Point(-5.51572, -13.467957, 30), Point(-10.846802, -14.906151, 30), Point(-14.746186, -17.44017, 30), Point(-17.305903, -20.802022, 30), Point(-18.617983, -24.723716, 30), Point(-18.774458, -28.93726, 30)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])
python = GhPythonScript(points=pt)  # -> out, tree; inputs points: list of Point3d
# ---------- python: Python ----------
"""This is a simple component.
    Inputs:
        x: The x script variable
        y: The y script variable
    Output:
        a: The a output variable"""

from Grasshopper import DataTree
from Grasshopper.Kernel.Data import GH_Path
from Rhino.Geometry import Point3d

#Data Trees
tree = DataTree[Point3d]()

pathCount = 0
newPath = GH_Path(pathCount)

for num in range(len(points)):
    if num % 20 == 0 and num != 0:
        pathCount += 1
        newPath = GH_Path(pathCount)
    tree.Add(points[num], newPath)
# ---------- end python ----------
python_2 = GhPythonScript(points=python.tree)  # -> out, a; inputs points: tree of Point3d
# ---------- python_2: Python ----------
"""This is a simple component.
    Inputs:
        x: The x script variable
        y: The y script variable
    Output:
        a: The a output variable"""

import ghpythonlib.components as ghc

#GH Components

crvs = []

for lst in range(points.BranchCount):
    branchPoints = points.Branch(lst)
    nCurve = ghc.NurbsCurve(branchPoints, 3, False)
    crvs.append(nCurve.curve)

a = ghc.Loft(crvs)
# ---------- end python_2 ----------
loft = Loft(Options={Adjust=False, Closed=False, LoftEnds=0, LoftSimp=0, LoftType=0, Rebuild=10, Refit=0.01})
panel = Panel(python_2.out)
nurbs = NurbsCurve(Degree=3, Periodic=False)  # -> Curve, Length, Domain
