# Grasshopper definition 03_06.gh (Grasshopper 1.0.5)

pt = Point([Point(-5.51572, -13.467957, 30), Point(-10.846802, -14.906151, 30), Point(-14.746186, -17.44017, 30), Point(-17.305903, -20.802022, 30), Point(-18.617983, -24.723716, 30), Point(-18.774458, -28.93726, 30)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])
python = GhPythonScript(points=pt)  # -> out, tree; inputs points: list of Point3d
# ---------- python: Python ----------
"""This is a simple component.
    Inputs:
        x: The x script variable
        y: The y script variable
    Output:
        a: The a output variable"""

from Grasshopper import DataTree
from Grasshopper.Kernel.Data import GH_Path
from Rhino.Geometry import Point3d

#Data Trees
tree = DataTree[Point3d]()

pathCount = 0
newPath = GH_Path(pathCount)

for num in range(len(points)):
    if num % 20 == 0 and num != 0:
        pathCount += 1
        newPath = GH_Path(pathCount)
    tree.Add(points[num], newPath)
# ---------- end python ----------
python_2 = GhPythonScript(points=python.tree)  # -> out, a, crvs; inputs points: tree of Point3d
# ---------- python_2: Python ----------
"""This is a simple component.
    Inputs:
        x: The x script variable
        y: The y script variable
    Output:
        a: The a output variable"""

import ghpythonlib.components as ghc

#GH Components

crvs = []

for lst in range(points.BranchCount):
    branchPoints = points.Branch(lst)
    nCurve = ghc.NurbsCurve(branchPoints, 3, False)
    crvs.append(nCurve.curve)

a = ghc.Loft(crvs)
# ---------- end python_2 ----------

item = ListItem(List=python_2.crvs, Index=0, Wrap=True)
pframes = PerpFrames(Curve=item, Count=Slider(600, range=0..1200), Align=True)  # -> Frames, Parameters
planesrf = PlaneSurface(Plane=pframes.Frames, XSize=Domain(-3, 3), YSize=Domain(-50, 10))
bbx = BrepBrep(BrepA=python_2.a, BrepB=planesrf, UseTasks=True)  # -> flatten(Curves), Points

python_3 = GhPythonScript(crvs=bbx.Curves)  # -> out, pipes; inputs crvs: list of Curve
# ---------- python_3: Python ----------
"""This is a simple component.
    Inputs:
        x: The x script variable
        y: The y script variable
    Output:
        a: The a output variable"""

import ghpythonlib.parallel as ghp
import ghpythonlib.components as ghc

#Function
def pipeit(crv):
    return ghc.Pipe(crv, 0.1, 1)

pipes = ghp.run(pipeit, crvs, True)
# ---------- end python_3 ----------
pipe = Pipe(Curve=bbx.Curves, Radius=0.1, Caps=1)
