# Grasshopper definition 03_07.gh (Grasshopper 1.0.5)

pt = Point([Point(-5.51572, -13.467957, 30), Point(-10.846802, -14.906151, 30), Point(-14.746186, -17.44017, 30), Point(-17.305903, -20.802022, 30), Point(-18.617983, -24.723716, 30), Point(-18.774458, -28.93726, 30)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])
python = GhPythonScript(x=pt, y=Slider(11, range=0..100))  # -> out, a; inputs x: list of Point3d, y: Int32
# ---------- python: Python ----------
"""This is a simple component.
    Inputs:
        x: The x script variable
        y: The y script variable
    Output:
        a: The a output variable"""

import TreeFunctions as tf
reload(tf)

a = tf.treeBranch(x, y)
# ---------- end python ----------
panel = Panel(python.a)
