# Grasshopper definition 04_02.gh (Grasshopper 1.0.5)

srf = Surface(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)
python = GhPythonScript(surface=srf, uDiv=Slider(8, range=1..20), vDiv=Slider(14, range=1..50))  # -> out, points; inputs surface: Surface, uDiv: Int32, vDiv: Int32
# ---------- python: Python ----------
"""This is a simple component.
    Inputs:
        x: The x script variable
        y: The y script variable
    Output:
        a: The a output variable"""

import Rhino.Geometry as rg

points = []

#Domain
domain = rg.Interval(0,1)
surface.SetDomain(0, domain)
surface.SetDomain(1, domain)

#UV Divisions
for u in range(uDiv + 1):
    for v in range(vDiv + 1):
        point = surface.PointAt(u/uDiv, v/vDiv)
        points.append(point)
# ---------- end python ----------
