# Grasshopper definition 04_03.gh (Grasshopper 1.0.5)

srf = Surface(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)
python = GhPythonScript(surface=srf, uDiv=Slider(8, range=1..20), vDiv=Slider(14, range=1..50))  # -> out, points; inputs surface: Surface, uDiv: Int32, vDiv: Int32
# ---------- python: Python ----------
"""This is a simple component.
    Inputs:
        x: The x script variable
        y: The y script variable
    Output:
        a: The a output variable"""

import Rhino.Geometry as rg

points = []

#Domain
domain = rg.Interval(0,1)
surface.SetDomain(0, domain)
surface.SetDomain(1, domain)

#UV Divisions
for u in range(uDiv):
    for v in range(vDiv):
        p1 = surface.PointAt(u/uDiv, v/vDiv)
        p2 = surface.PointAt((u+1)/uDiv, v/vDiv)
        p3 = surface.PointAt((u+1)/uDiv, (v+1)/vDiv)
        p4 = surface.PointAt(u/uDiv, (v+1)/vDiv)
        
        panel = rg.NurbsSurface.CreateFromCorners(p1,p2,p3,p4)
        
        points.append(panel)
# ---------- end python ----------
