# Grasshopper definition 04_05.gh (Grasshopper 1.0.5)

srf = Surface(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)
python = GhPythonScript(surface=srf, uDiv=Slider(8, range=1..20), vDiv=Slider(14, range=1..50))  # -> out, surfaces; inputs surface: Surface, uDiv: Int32, vDiv: Int32
# ---------- python: Python ----------
"""This is a simple component.
    Inputs:
        x: The x script variable
        y: The y script variable
    Output:
        a: The a output variable"""

import Rhino.Geometry as rg

curves = []

#Domain
domain = rg.Interval(0,1)
surface.SetDomain(0, domain)
surface.SetDomain(1, domain)

#Isocurve Extraction
for u in range(uDiv):
    if u == 0 or u/uDiv == 1:
        continue
    else:
        uCurve = surface.IsoCurve(1, u/uDiv)
        curves.append(uCurve)

for v in range(vDiv):
    if v == 0 or v/vDiv == 1:
        continue
    else:
        vCurve = surface.IsoCurve(0, v/vDiv)
        curves.append(vCurve)

#Get BrepFace
surfBrep = surface.ToBrep()
brepFace = surfBrep.Faces[0]
splits = brepFace.Split(curves, 0.001)
faces = splits.Faces
faces.ShrinkFaces()

#split surfaces
surfaces = []

for i in range(faces.Count):
    surfaces.append(faces.ExtractFace(i))
# ---------- end python ----------
python_2 = GhPythonScript(panels=python.surfaces)  # -> out, sortedP; inputs panels: list of Surface
# ---------- python_2: Python ----------
"""This is a simple component.
    Inputs:
        x: The x script variable
        y: The y script variable
    Output:
        a: The a output variable"""

import Rhino.Geometry as rg

domain = rg.Interval(0, 1)

#Sort Panels
def sortFunc(panel):
    panel.SetDomain(0, domain)
    panel.SetDomain(1, domain)
    point = panel.PointAt(0.5, 0.5)
    
    val = (point.Z * 10000) + (point.Y * 100) + point.X
    return val

sortedP = sorted(panels, key = sortFunc, reverse = True)
# ---------- end python_2 ----------
item = ListItem(List=python_2.sortedP, Index=Slider(49, range=0..100), Wrap=True)
