# Grasshopper definition 04_08.gh (Grasshopper 1.0.5)

srf = Surface(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)
python = GhPythonScript(surface=srf, uDiv=Slider(8, range=1..20), vDiv=Slider(25, range=1..50))  # -> out, surfaces; inputs surface: Surface, uDiv: Int32, vDiv: Int32
# ---------- python: Python ----------
"""This is a simple component.
    Inputs:
        x: The x script variable
        y: The y script variable
    Output:
        a: The a output variable"""

import Rhino.Geometry as rg

curves = []

#Domain
domain = rg.Interval(0,1)
surface.SetDomain(0, domain)
surface.SetDomain(1, domain)

#Isocurve Extraction
for u in range(uDiv):
    if u == 0 or u/uDiv == 1:
        continue
    else:
        uCurve = surface.IsoCurve(1, u/uDiv)
        curves.append(uCurve)

for v in range(vDiv):
    if v == 0 or v/vDiv == 1:
        continue
    else:
        vCurve = surface.IsoCurve(0, v/vDiv)
        curves.append(vCurve)

#Get BrepFace
surfBrep = surface.ToBrep()
brepFace = surfBrep.Faces[0]
splits = brepFace.Split(curves, 0.001)
faces = splits.Faces
faces.ShrinkFaces()

#split surfaces
surfaces = []

for i in range(faces.Count):
    surfaces.append(faces.ExtractFace(i))
# ---------- end python ----------
python_2 = GhPythonScript(panels=python.surfaces)  # -> out, sortedP; inputs panels: list of Surface
# ---------- python_2: Python ----------
"""This is a simple component.
    Inputs:
        x: The x script variable
        y: The y script variable
    Output:
        a: The a output variable"""

import Rhino.Geometry as rg

domain = rg.Interval(0, 1)

#Sort Panels
def sortFunc(panel):
    panel.SetDomain(0, domain)
    panel.SetDomain(1, domain)
    point = panel.PointAt(0.5, 0.5)
    
    val = (point.Z * 10000) + (point.Y * 100) + point.X
    return val

sortedP = sorted(panels, key = sortFunc, reverse = True)
# ---------- end python_2 ----------
pt = Point(<point referenced from the Rhino model>)
python_3 = GhPythonScript(
    panels=python_2.sortedP,
    attractor=pt,
    min=Slider(0.116, range=0..1),
    max=Slider(0.697, range=0..1),
    viewAngle=Slider(4, range=-20..20))  # -> out, frames, frameCtrs; inputs panels: list of Surface, attractor: Point3d
# ---------- python_3: Python ----------
"""This is a simple component.
    Inputs:
        x: The x script variable
        y: The y script variable
    Output:
        a: The a output variable"""

import Rhino.Geometry as rg
from math import radians

distances = []
frames = []
frameCtrs = []

#Distances
for panel in panels:
    point = panel.PointAt(0.5,0.5)
    dist = point.DistanceTo(attractor)
    distances.append(dist)

distances.sort()
dmin = distances[0]
dmax = distances[-1]
range = dmax - dmin

#Transform
for panel in panels:
    panelC = panel.Duplicate()
    centreF = panelC.FrameAt(0.5,0.5)[1]
    dist = centreF.Origin.DistanceTo(attractor)
    scaledist = (dist - dmin)/range * (max-min) + min
    
    #Scale
    trans = rg.Transform.Scale(centreF.Origin, scaledist)
    panelC.Transform(trans)
    
    #Move
    moveDir = centreF.ZAxis
    moveVect = rg.Vector3d.Multiply(scaledist * 3, moveDir)
    moveTrans = rg.Transform.Translation(moveVect)
    panelC.Transform(moveTrans)
    
    #Rotation
    rotateTrans = rg.Transform.Rotation(radians(viewAngle), centreF.Origin)
    panelC.Transform(rotateTrans)
    
    centreF = panelC.FrameAt(0.5,0.5)[1]
    
    #Lofting
    panelA = panel.ToBrep()
    panelAedges = panelA.DuplicateEdgeCurves()
    panelAcurve = rg.Curve.JoinCurves(panelAedges)
    
    panelB = panelC.ToBrep()
    panelBedges = panelB.DuplicateEdgeCurves()
    panelBcurve = rg.Curve.JoinCurves(panelBedges)
    
    edgeCurves = []
    edgeCurves.append(panelAcurve[0])
    edgeCurves.append(panelBcurve[0])
    
    panelBrep = rg.Brep.CreateFromLoft(edgeCurves, rg.Point3d.Unset, rg.Point3d.Unset, rg.LoftType.Normal, False)
 
    frames.append(panelBrep[0])
    frameCtrs.append(centreF)
# ---------- end python_3 ----------
geo = Geometry([<brep referenced from the Rhino model> x8])
python_4 = GhPythonScript(frameCtrs=python_3.frameCtrs, context=geo)  # -> out, intPoints, hitPercent; inputs frameCtrs: list of Plane, context: list of Brep
# ---------- python_4: Python ----------
"""This is a simple component.
    Inputs:
        x: The x script variable
        y: The y script variable
    Output:
        a: The a output variable"""

import Rhino.Geometry as rg

intPoints = []

for framePlane in frameCtrs:
    #Ray
    ray = rg.Ray3d(framePlane.Origin, framePlane.ZAxis)
    
    #Shoot Ray
    intP = rg.Intersect.Intersection.RayShoot(ray, context, 1)
    
    if intP == None:
        intPoints.append(None)
    else:
        intPoints.append(intP[0])

#Hit Percentage
noHits = intPoints.count(None)
hits = len(frameCtrs) - noHits
hitP = hits/len(frameCtrs) * 100

hitPercent = "Hit Ratio: {}%".format(hitP)
# ---------- end python_4 ----------
deplane = DeconstructPlane(Plane=python_3.frameCtrs)  # -> Origin, XAxis, YAxis, ZAxis
amp = Amplitude(Vector=deplane.ZAxis, Amplitude=100)
tag = TextTag3D(
    Location=Plane(origin=(50.81106079, 52.56962251, 0), x=(0, -1, 0), y=(1, 0, 0)),
    Text=python_4.hitPercent,
    Size=5,
    Justification=7)
vdis = VectorDisplay(Anchor=deplane.Origin, Vector=amp)
