# Grasshopper definition 04_13.gh (Grasshopper 1.0.5)

srf = Surface(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)
python = GhPythonScript(surface=srf, uDiv=Slider(8, range=1..20), vDiv=Slider(25, range=1..50))  # -> out, surfaces; inputs surface: Surface, uDiv: Int32, vDiv: Int32
# ---------- python: Python ----------
"""This is a simple component.
    Inputs:
        x: The x script variable
        y: The y script variable
    Output:
        a: The a output variable"""

import Rhino.Geometry as rg

curves = []

#Domain
domain = rg.Interval(0,1)
surface.SetDomain(0, domain)
surface.SetDomain(1, domain)

#Isocurve Extraction
for u in range(uDiv):
    if u == 0 or u/uDiv == 1:
        continue
    else:
        uCurve = surface.IsoCurve(1, u/uDiv)
        curves.append(uCurve)

for v in range(vDiv):
    if v == 0 or v/vDiv == 1:
        continue
    else:
        vCurve = surface.IsoCurve(0, v/vDiv)
        curves.append(vCurve)

#Get BrepFace
surfBrep = surface.ToBrep()
brepFace = surfBrep.Faces[0]
splits = brepFace.Split(curves, 0.001)
faces = splits.Faces
faces.ShrinkFaces()

#split surfaces
surfaces = []

for i in range(faces.Count):
    surfaces.append(faces.ExtractFace(i))
# ---------- end python ----------
number_slider = Slider(15, range=-15..15)
python_2 = GhPythonScript(panels=python.surfaces)  # -> out, sortedP; inputs panels: list of Surface
# ---------- python_2: Python ----------
"""This is a simple component.
    Inputs:
        x: The x script variable
        y: The y script variable
    Output:
        a: The a output variable"""

import Rhino.Geometry as rg

domain = rg.Interval(0, 1)

#Sort Panels
def sortFunc(panel):
    panel.SetDomain(0, domain)
    panel.SetDomain(1, domain)
    point = panel.PointAt(0.5, 0.5)
    
    val = (point.Z * 10000) + (point.Y * 100) + point.X
    return val

sortedP = sorted(panels, key = sortFunc, reverse = True)
# ---------- end python_2 ----------
pt = Point(<point referenced from the Rhino model>)
python_3 = GhPythonScript(
    panels=python_2.sortedP,
    attractor=pt,
    min=Slider(0.116, range=0..1),
    max=Slider(0.697, range=0..1),
    viewAngle=number_slider)  # -> out, frames, frameCtrs; inputs panels: list of Surface, attractor: Point3d
# ---------- python_3: Python ----------
"""This is a simple component.
    Inputs:
        x: The x script variable
        y: The y script variable
    Output:
        a: The a output variable"""

import Rhino.Geometry as rg
from math import radians

distances = []
frames = []
frameCtrs = []

#Distances
for panel in panels:
    point = panel.PointAt(0.5,0.5)
    dist = point.DistanceTo(attractor)
    distances.append(dist)

distances.sort()
dmin = distances[0]
dmax = distances[-1]
range = dmax - dmin

#Transform
for panel in panels:
    panelC = panel.Duplicate()
    centreF = panelC.FrameAt(0.5,0.5)[1]
    dist = centreF.Origin.DistanceTo(attractor)
    scaledist = (dist - dmin)/range * (max-min) + min
    
    #Scale
    trans = rg.Transform.Scale(centreF.Origin, scaledist)
    panelC.Transform(trans)
    
    #Move
    moveDir = centreF.ZAxis
    moveVect = rg.Vector3d.Multiply(scaledist * 3, moveDir)
    moveTrans = rg.Transform.Translation(moveVect)
    panelC.Transform(moveTrans)
    
    #Rotation
    rotateTrans = rg.Transform.Rotation(radians(viewAngle), centreF.Origin)
    panelC.Transform(rotateTrans)
    
    centreF = panelC.FrameAt(0.5,0.5)[1]
    
    #Lofting
    panelA = panel.ToBrep()
    panelAedges = panelA.DuplicateEdgeCurves()
    panelAcurve = rg.Curve.JoinCurves(panelAedges)
    
    panelB = panelC.ToBrep()
    panelBedges = panelB.DuplicateEdgeCurves()
    panelBcurve = rg.Curve.JoinCurves(panelBedges)
    
    edgeCurves = []
    edgeCurves.append(panelAcurve[0])
    edgeCurves.append(panelBcurve[0])
    
    panelBrep = rg.Brep.CreateFromLoft(edgeCurves, rg.Point3d.Unset, rg.Point3d.Unset, rg.LoftType.Normal, False)
 
    frames.append(panelBrep[0])
    frameCtrs.append(centreF)
# ---------- end python_3 ----------
geo = Geometry([<brep referenced from the Rhino model> x8])
python_4 = GhPythonScript(
    bake=Toggle(True),
    frames=python_3.frames,
    frameCtrs=python_3.frameCtrs,
    context=geo,
    col1=ColourSwatch(SwatchColor=RGB(103, 255, 69)),
    col2=ColourSwatch(SwatchColor=RGB(255, 161, 61)),
    viewAngle=number_slider)  # -> out, intPoints, hitPercent, layers; inputs bake: Boolean, frames: list of Brep, frameCtrs: list of Plane, context: list of Brep, col1: Color, col2: Color, viewAngle: Int32
# ---------- python_4: Python ----------
"""This is a simple component.
    Inputs:
        x: The x script variable
        y: The y script variable
    Output:
        a: The a output variable"""

import Rhino.Geometry as rg
import Rhino.DocObjects as rd
import scriptcontext as sc
import Rhino as r

intPoints = []

#Rhino Doc
sc.doc = r.RhinoDoc.ActiveDoc

#Layer Names
layercol1 = "Panel Green"
layercol2 = "Panel Orange"
layers = [layercol1, layercol2]

for framePlane, frame in zip(frameCtrs, frames):
    #Ray
    ray = rg.Ray3d(framePlane.Origin, framePlane.ZAxis)
    
    #Shoot Ray
    intP = rg.Intersect.Intersection.RayShoot(ray, context, 1)
    
    if intP == None:
        intPoints.append(None)
    else:
        intPoints.append(intP[0])
    
    #Baking
    if bake:
        objA = rd.ObjectAttributes()
        objA.ColorSource = rd.ObjectColorSource.ColorFromObject
        
        if intP == None:
            objA.ObjectColor = col1
            
            layeri = sc.doc.Layers.Find(layercol1, True)
            if layeri < 0:
                layer = rd.Layer()
                layer.Name = layercol1
                layeri = sc.doc.Layers.Add(layer)
            objA.LayerIndex = layeri
            sc.doc.Objects.AddBrep(frame, objA)
        else:
            objA.ObjectColor = col2
            
            layeri = sc.doc.Layers.Find(layercol2, True)
            if layeri < 0:
                layer = rd.Layer()
                layer.Name = layercol2
                layeri = sc.doc.Layers.Add(layer)
            objA.LayerIndex = layeri
            sc.doc.Objects.AddBrep(frame, objA)

#Hit Percentage
noHits = intPoints.count(None)
hits = len(frameCtrs) - noHits
hitP = hits/len(frameCtrs) * 100

hitPercent = "Hit Ratio: {}%".format(hitP)
angleT = "View Angle: {}".format(viewAngle)

if bake:
    #Create Text
    hitTxt = r.Display.Text3d(hitPercent, rg.Plane.WorldYZ, 5)
    plane = rg.Plane(rg.Point3d(0,0,7), rg.Plane.WorldXY.XAxis)
    angleTxt = r.Display.Text3d(angleT, plane, 5)
    
    #Object Attributes
    objA = rd.ObjectAttributes()
    layeri = sc.doc.Layers.Find(layercol2, True)
    objA.LayerIndex = layeri
    
    #Bake Text
    sc.doc.Objects.AddText(hitTxt, objA)
    sc.doc.Objects.AddText(angleTxt, objA)

sc.doc = ghdoc
# ---------- end python_4 ----------
python_5 = GhPythonScript(go=Toggle(True), count=number_slider, layers=python_4.layers)  # -> out, a; inputs go: Boolean, count: Int32, layers: list
# ---------- python_5: Python ----------
"""This is a simple component.
    Inputs:
        x: The x script variable
        y: The y script variable
    Output:
        a: The a output variable"""

import rhinoscriptsyntax as rs
import scriptcontext as sc
import Rhino as r

#Save Path
savePath = r"C:\Users\Jerem\Desktop\Exercises\04_12\End\Animation\\" + str(count) + ".png"


#Rendering
if go:
    rs.Command("_Render")
    rs.Command("_-SaveRenderWindowAs" + " " + savePath)
    rs.Command("_-CloseRenderWindow")
    
    sc.doc = r.RhinoDoc.ActiveDoc
    for layer in layers:
        geo = rs.ObjectsByLayer(layer)
        rs.DeleteObjects(geo)
    sc.doc = ghdoc
# ---------- end python_5 ----------
